% Simulink data dictionary data_interface.sldd

SetPoint = Simulink.Bus()
  reference: double, Unit="deg"

Ts = Simulink.Parameter(0.001, DataType="double", Min=0, Max=1, Unit="s")  % Sample time.

Joint_Feedback = Simulink.Bus()
  encoder: double, Unit="deg"
  velocity: double, Unit="deg/s"

Control_Command = Simulink.Bus()
  voltage: double, Min=-100, Max=100, Unit="%"

Driver_Feedback = Simulink.Bus()
  current: double, Unit="A"
  power: double, Unit="W"

Vcc = 24