test file "test_req"

suite "Test Requirements Suite for the Pendulum Controller System"
  description: This test suite serves to verify the requirements of the pendulum controller system.

  case "Test Pendulum 1" [simulation]
    model arch_logical, harness arch_logical_Harness_ReqTest
    parameter set "Parameter Set 1": pendulum_type = PendulumTypes.Pendulum_1, obstacle_enable = ObstacleMode.Off  % model workspace
    cleanup callback:
      run_mech_explorer(PendulumTypes.Pendulum_1, ObstacleMode.Off, './derived/voltage_1.mat');

  case "Test Pendulum 2" [simulation]
    model arch_logical, harness arch_logical_Harness_ReqTest
    parameter set "Parameter Set 1": pendulum_type = PendulumTypes.Pendulum_2, obstacle_enable = ObstacleMode.Off  % model workspace
    cleanup callback:
      run_mech_explorer(PendulumTypes.Pendulum_2, ObstacleMode.Off, './derived/voltage_2.mat');

  case "Test Safety" [simulation]
    model arch_logical, harness arch_logical_Harness_ConstantVelocity
    parameter set "Parameter Set 1": obstacle_enable = ObstacleMode.On, pendulum_type = PendulumTypes.Pendulum_1  % model workspace
    cleanup callback:
      run_mech_explorer(PendulumTypes.Pendulum_1, ObstacleMode.On, './derived/voltage_3.mat');